# Dynamo graph Coloumn Setoff Faces_2023.dyn "Coloumn Setoff_Final_Faces" (Dynamo 2.16.4.10216)
# packages: Genius Loci 2024.5.29

# group: Getting Columns and grids
categories = Categories("OST_StructuralColumns")
all_elements_of_category = ElementsOfCategory(Category=categories)
boundingBox = Element.BoundingBox(element=all_elements_of_category)
minPoint = BoundingBox.MinPoint(boundingBox=boundingBox)
maxPoint = BoundingBox.MaxPoint(boundingBox=boundingBox)
categories_2 = Categories("OST_Grids")
all_elements_of_category_2 = ElementsOfCategory(Category=categories_2)
curve = Grid.Curve(grid=all_elements_of_category_2)

# group: Points of the faces
min_z = Point.Z(point=minPoint)
max_z = Point.Z(point=maxPoint)
add = min_z + max_z
number = DoubleInput(2)
z_mid = add / number
max_x = Point.X(point=maxPoint)
min_y = Point.Y(point=minPoint)
max_y = Point.Y(point=maxPoint)
add_2 = min_y + max_y
y_mid = add_2 / number
X = Point.ByCoordinates(x=max_x, y=y_mid)
min_x = Point.X(point=minPoint)
x = Point.ByCoordinates(x=min_x, y=y_mid)
list_create = List.Create(item0=X, item1=x)
transpose = List.Transpose(lists=list_create)
add_3 = min_x + max_x
x_mid = add_3 / number
Y = Point.ByCoordinates(x=x_mid, y=max_y)
y = Point.ByCoordinates(x=x_mid, y=min_y)
list_create_2 = List.Create(item0=Y, item1=y)
transpose_2 = List.Transpose(lists=list_create_2)

# group: Seperate horizontal and vertical grids
python_script = Python(IN[0]=all_elements_of_category_2)  # CPython3
# ---------- python_script.python (44 lines) ----------
# -*- coding: utf-8 -*-
"""
Split a list of Grid elements into horizontal (X-direction)
and vertical (Y-direction) groups.

IN[0] : grids_in  list[Grid elements]  (Dynamo wrappers)

OUT[0] : horizontal_grids  list[Grid elements]
OUT[1] : vertical_grids    list[Grid elements]
"""

import clr
clr.AddReference('RevitAPI')
clr.AddReference('RevitServices')
clr.AddReference('RevitNodes')

from Autodesk.Revit.DB import Grid
from RevitServices.Persistence import DocumentManager
import Revit
clr.ImportExtensions(Revit.Elements)          # UnwrapElement()

# ---------- INPUT ----------
grids_in = IN[0]  # expect flat list of Dynamo Grid elements

# ---------- PROCESS ----------
horizontal_grids = []
vertical_grids   = []

for g_dy in grids_in:
    db_grid = UnwrapElement(g_dy)
    if not isinstance(db_grid, Grid):
        continue                        # skip any stray geometry/nulls

    curve = db_grid.Curve               # DB.Line or DB.Arc
    sp, ep = curve.GetEndPoint(0), curve.GetEndPoint(1)
    dx, dy = abs(ep.X - sp.X), abs(ep.Y - sp.Y)

    if dx > dy:                         # more horizontal
        horizontal_grids.append(db_grid)
    else:                               # more vertical (or equal)
        vertical_grids.append(db_grid)

# ---------- OUTPUT ----------
OUT = horizontal_grids, vertical_grids
# ----------------------------------------
code_block = CodeBlock { 0; 1; }
horizontal_grid = List.GetItemAtIndex(list=python_script, index=code_block.out0)
element_reference = Custom[Element Reference](element=horizontal_grid)  # package Genius Loci; Gets the reference of a geometric object or a dimension or a reference plane.
vertical_grid = List.GetItemAtIndex(list=python_script, index=code_block.out1)
element_reference_2 = Custom[Element Reference](element=vertical_grid)

# group: Get dimesnion Type
element_classes = ElementTypes("DimensionType")
all_elements_of_class = ElementsOfType(element_class=element_classes)
name = Element.Name(element=all_elements_of_class)
code_block_2 = CodeBlock { 0; }
getItemAtIndex = List.GetItemAtIndex(list=all_elements_of_class, index=code_block_2)

# group: Get current View
current = Document.Current()
activeView = Document.ActiveView(document=current)

# group: Creating Shortest Vector
create_vectors = Python(IN[0]=transpose, IN[1]=transpose_2, IN[2]=curve)  # CPython3
# ---------- create_vectors.python (70 lines) ----------
import clr
clr.AddReference('ProtoGeometry')
from Autodesk.DesignScript.Geometry import *

# --- Inputs ---
face_pts_x_all = IN[0]  # List of [–X, +X] points per column
face_pts_y_all = IN[1]  # List of [–Y, +Y] points per column
grid_lines = IN[2]      # All Revit grid curves

# --- STEP 1: Classify Grids into Horizontal and Vertical ---
horizontal_grids = []
vertical_grids = []

for g in grid_lines:
    if not isinstance(g, Line):
        continue
    sp = g.StartPoint
    ep = g.EndPoint
    dx = abs(ep.X - sp.X)
    dy = abs(ep.Y - sp.Y)
    if dx > dy:
        horizontal_grids.append(g)  # left-right (for Y face)
    else:
        vertical_grids.append(g)    # up-down (for X face)

# --- STEP 2: Flatten to XY plane ---
def flatten_point(pt):
    return Point.ByCoordinates(pt.X, pt.Y, 0)

def shortest_vector_to_grids(pt, grids):
    if pt is None: return None, float('inf')
    pt2d = flatten_point(pt)
    min_dist = float('inf')
    best_vector = None
    for grid in grids:
        proj = flatten_point(grid.ClosestPointTo(pt))
        dist = pt2d.DistanceTo(proj)
        if dist < min_dist:
            min_dist = dist
            best_vector = Line.ByStartPointEndPoint(pt, proj)
    return best_vector, min_dist

# --- STEP 3: Loop through all columns (manual longest logic) ---
vectors_x = []
vectors_y = []

count = max(len(face_pts_x_all), len(face_pts_y_all))

for i in range(count):
    # Safely get current face point pairs
    fx = face_pts_x_all[i] if i < len(face_pts_x_all) else [None, None]
    fy = face_pts_y_all[i] if i < len(face_pts_y_all) else [None, None]

    # Check for valid face points
    if fx is None or len(fx) < 2:
        vectors_x.append(None)
    else:
        vec1, dist1 = shortest_vector_to_grids(fx[0], vertical_grids)  # –X
        vec2, dist2 = shortest_vector_to_grids(fx[1], vertical_grids)  # +X
        vectors_x.append(vec1 if dist1 < dist2 else vec2)

    if fy is None or len(fy) < 2:
        vectors_y.append(None)
    else:
        vec1, dist1 = shortest_vector_to_grids(fy[0], horizontal_grids)  # –Y
        vec2, dist2 = shortest_vector_to_grids(fy[1], horizontal_grids)  # +Y
        vectors_y.append(vec1 if dist1 < dist2 else vec2)

# --- Final Output ---
OUT = vectors_x, vectors_y
# ----------------------------------------
code_block_3 = CodeBlock { 0; 1; }
x_vector = List.GetItemAtIndex(list=create_vectors, index=code_block_3.out0)
y_vector = List.GetItemAtIndex(list=create_vectors, index=code_block_3.out1)

# group: Collecting References
element_surfaces_references = Custom[Element Surfaces References](element=all_elements_of_category)  # package Genius Loci; Retrieve the top, bottom, side surfaces and their associated references of the system family. This doesn't work with cylindrical system families (pipe...)
flatten = List.Flatten(list=element_surfaces_references.out5)
flatten_2 = List.Flatten(list=element_surfaces_references.out7)
x_direction_column_references = Python(IN[0]=flatten, IN[1]=flatten_2, IN[2]=x_vector)  # CPython3
# ---------- x_direction_column_references.python (24 lines) ----------
# IN[0] : xMinusRefs  list[Reference]   (–X face)
# IN[1] : xPlusRefs   list[Reference]   (+X face)
# IN[2] : vectors_x   list[DS Line]

import clr
clr.AddReference('ProtoGeometry')
from Autodesk.DesignScript.Geometry import Line

minus, plus, vecs = IN
chosen = []

for m, p, v in zip(minus, plus, vecs):
    if v is None:               # skip if no vector
        chosen.append(None)
        continue
    # compare which face the vector starts from:
    #  • if its StartPoint equals (or is very close to) the –X face point, pick m
    #  • otherwise pick p
    if abs(v.StartPoint.X - v.EndPoint.X) < 1e-6:   # vertical vector ⇒ must be ±X faces
        chosen.append(m if v.StartPoint.X < v.EndPoint.X else p)
    else:
        # safer: use whichever reference lives on the smaller distance
        chosen.append(m)        # fallback: assume you know order
OUT = chosen
# ----------------------------------------
flatten_3 = List.Flatten(list=element_surfaces_references.out9)
flatten_4 = List.Flatten(list=element_surfaces_references.out11)
y_direction_column_references = Python(IN[0]=flatten_3, IN[1]=flatten_4, IN[2]=y_vector)  # CPython3; same code as x_direction_column_references

# group: Place dimensions
mutiple_of_column_size = CodeBlock { 2; }
python_script_2 = Python(IN[0]=activeView, IN[1]=x_vector, IN[2]=x_direction_column_references, IN[3]=vertical_grid, IN[4]=getItemAtIndex, IN[5]=mutiple_of_column_size)  # IronPython2
# ---------- python_script_2.python (147 lines) ----------
# -*- coding: utf-8 -*-
import clr, math
clr.AddReference('RevitAPI')
clr.AddReference('RevitServices')
clr.AddReference('RevitNodes')
clr.AddReference('ProtoGeometry')

from Autodesk.Revit.DB import *
from RevitServices.Persistence import DocumentManager
from RevitServices.Transactions import TransactionManager
import Revit
clr.ImportExtensions(Revit.Elements)
clr.ImportExtensions(Revit.GeometryConversion)

# ---------- INPUTS ----------
view_dy, vectors, col_refs, grids_in, dimType_in, offset_multiplier = IN
view    = UnwrapElement(view_dy)
doc     = DocumentManager.Instance.CurrentDBDocument
dimType = UnwrapElement(dimType_in) if dimType_in else None
mult    = offset_multiplier if offset_multiplier else 1.0

# ---------- helpers ----------
def unit_xy(xyz):
    return XYZ(xyz.X, xyz.Y, 0.0).Normalize()

def is_perpendicular(v1, v2):
    return abs(v1.DotProduct(v2)) < 0.3

def face_matches(face, vec):
    try:
        n = face.ComputeNormal(UV(0.5, 0.5))
        return unit_xy(n).IsAlmostEqualTo(vec, 1e-3)
    except:
        return False

def ref_sort_key(r, axis):
    el = doc.GetElement(r.ElementId)
    geo = el.GetGeometryObjectFromReference(r)
    if isinstance(geo, PlanarFace):
        pt = geo.Origin
    elif isinstance(geo, Edge):
        pt = geo.AsCurve().Evaluate(0.5, True)
    elif isinstance(el, Grid):
        ln = el.Curve if isinstance(el.Curve, Line) else None
        pt = ln.Evaluate(0.5, True) if ln else XYZ.Zero
    else:
        pt = XYZ.Zero
    return pt.DotProduct(axis)

# ---------- collect straight grids ----------
grids = []
for g in grids_in:
    g_db = UnwrapElement(g)
    if isinstance(g_db, Grid) and isinstance(g_db.Curve, Line):
        g_ref = Reference(g_db)
        grids.append((g_db.Curve, g_ref))

# ---------- MAIN ----------
out_dims = []
TransactionManager.Instance.EnsureInTransaction(doc)

for col_ref, vec in zip(col_refs, vectors):
    if not col_ref or not vec:
        out_dims.append(None)
        continue

    line = vec.ToRevitType()
    v_dir = unit_xy(line.Direction)  # Face direction (+ side)
    axis = unit_xy(XYZ(-v_dir.Y, v_dir.X, 0))  # Dimension axis (perpendicular)
    v_end = line.GetEndPoint(1)

    column = doc.GetElement(col_ref)
    if not column:
        out_dims.append(None)
        continue

    # Column bounding box
    bb = column.get_BoundingBox(view)
    if not bb:
        out_dims.append(None)
        continue
    w = abs(bb.Max.X - bb.Min.X)
    d = abs(bb.Max.Y - bb.Min.Y)

    # Geometry faces
    opts = Options()
    opts.ComputeReferences = True
    opts.IncludeNonVisibleObjects = True
    face_plus = face_minus = None
    for sol in (g for g in column.get_Geometry(opts) if isinstance(g, Solid)):
        for f in sol.Faces:
            if face_matches(f,  v_dir): face_plus = f.Reference
            if face_matches(f, -v_dir): face_minus = f.Reference
        if face_plus and face_minus:
            break
    if not (face_plus and face_minus):
        out_dims.append(None)
        continue

    # Nearest perpendicular grid
    best_grid_ref, best_dist = None, 1e9
    for g_curve, g_ref in grids:
        if not is_perpendicular(v_dir, unit_xy(g_curve.Direction)):
            continue
        dist = g_curve.Project(v_end).Distance
        if dist < best_dist:
            best_dist, best_grid_ref = dist, g_ref
    if not best_grid_ref:
        out_dims.append(None)
        continue

    # ---- Grid-to-nearest-face dimension (positive offset) ----
    refs_gf = sorted([best_grid_ref, face_plus], key=lambda r: ref_sort_key(r, axis))
    ref_arr_gf = ReferenceArray()
    for r in refs_gf:
        ref_arr_gf.Append(r)

    off_vec_gf = XYZ(0, (d/2.0)*mult, 0) if abs(v_dir.X) > abs(v_dir.Y) else XYZ((w/2.0)*mult, 0, 0)
    pt0_gf = line.GetEndPoint(0).Add(off_vec_gf)
    pt1_gf = line.GetEndPoint(1).Add(off_vec_gf)
    dim_line_gf = Line.CreateBound(pt0_gf, pt1_gf)

    try:
        dim_gf = doc.Create.NewDimension(view, dim_line_gf, ref_arr_gf, dimType) if dimType else doc.Create.NewDimension(view, dim_line_gf, ref_arr_gf)
        out_dims.append(dim_gf)
    except:
        out_dims.append(None)

    # ---- Whole-column dimension (-ve offset) ----
    refs_ff = sorted([face_plus, face_minus], key=lambda r: ref_sort_key(r, axis))
    ref_arr_ff = ReferenceArray()
    for r in refs_ff:
        ref_arr_ff.Append(r)

    off_vec_ff = XYZ(0, -(d/2.0)*mult, 0) if abs(v_dir.X) > abs(v_dir.Y) else XYZ(-(w/2.0)*mult, 0, 0)
    pt0_ff = line.GetEndPoint(0).Add(off_vec_ff)
    pt1_ff = line.GetEndPoint(1).Add(off_vec_ff)
    dim_line_ff = Line.CreateBound(pt0_ff, pt1_ff)

    try:
        dim_ff = doc.Create.NewDimension(view, dim_line_ff, ref_arr_ff, dimType) if dimType else doc.Create.NewDimension(view, dim_line_ff, ref_arr_ff)
        out_dims.append(dim_ff)
    except:
        out_dims.append(None)

TransactionManager.Instance.TransactionTaskDone()
OUT = out_dims
# ----------------------------------------
python_script_3 = Python(IN[0]=activeView, IN[1]=y_vector, IN[2]=y_direction_column_references, IN[3]=horizontal_grid, IN[4]=getItemAtIndex, IN[5]=mutiple_of_column_size)  # IronPython2; same code as python_script_2
