# Dynamo graph Coloumn Setoff Faces_2024.dyn (Dynamo 2.19.3.6394)
# packages: Genius Loci 2024.5.29

# group: Getting Columnd and grids ponts and lines
select_columns = Categories()  # nothing selected; graph input
all_elements_of_category = ElementsOfCategory(Category=select_columns)
boundingBox = Element.BoundingBox(element=all_elements_of_category)
minPoint = BoundingBox.MinPoint(boundingBox=boundingBox)
maxPoint = BoundingBox.MaxPoint(boundingBox=boundingBox)
select_grids = Categories()  # nothing selected; graph input
all_elements_of_category_2 = ElementsOfCategory(Category=select_grids)
curve = Grid.Curve(grid=all_elements_of_category_2)
separate_horizontal_and_vertical = Python(IN[0]=curve)  # "Separate Horizontal and Vertical Grids"; CPython3
# ---------- separate_horizontal_and_vertical.python (35 lines) ----------
# Load the Python Standard and DesignScript Libraries
import sys
import clr
clr.AddReference('ProtoGeometry')
from Autodesk.DesignScript.Geometry import *

# The inputs to this node will be stored as a list in the IN variables.
grid_lines = IN[0]

# Initialize lists for horizontal and vertical grids
horizontal_grids = []
vertical_grids = []
horizontal_indices = []
vertical_indices = []

# Check each grid line
for i, line in enumerate(grid_lines):
    # Get the direction vector of the line
    start_point = line.StartPoint
    end_point = line.EndPoint
    
    # Calculate direction
    dx = abs(end_point.X - start_point.X)
    dy = abs(end_point.Y - start_point.Y)
    
    # If dx > dy, it's more horizontal; otherwise, it's more vertical
    if dx > dy:
        horizontal_grids.append(line)
        horizontal_indices.append(i)
    else:
        vertical_grids.append(line)
        vertical_indices.append(i)

# Assign your output to the OUT variable.
OUT = [horizontal_grids, vertical_grids, horizontal_indices, vertical_indices]
# ----------------------------------------

# group: Points of the faces
min_z = Point.Z(point=minPoint)
max_z = Point.Z(point=maxPoint)
add = min_z + max_z
number = DoubleInput(2)
z_mid = add / number
max_x = Point.X(point=maxPoint)
min_y = Point.Y(point=minPoint)
max_y = Point.Y(point=maxPoint)
add_2 = min_y + max_y
y_mid = add_2 / number
X = Point.ByCoordinates(x=max_x, y=y_mid)
min_x = Point.X(point=minPoint)
x = Point.ByCoordinates(x=min_x, y=y_mid)
list_create = List.Create(item0=X, item1=x)
transpose = List.Transpose(lists=list_create)
add_3 = min_x + max_x
x_mid = add_3 / number
Y = Point.ByCoordinates(x=x_mid, y=max_y)
y = Point.ByCoordinates(x=x_mid, y=min_y)
list_create_2 = List.Create(item0=Y, item1=y)
transpose_2 = List.Transpose(lists=list_create_2)

create_vectors = Python(IN[0]=transpose, IN[1]=transpose_2, IN[2]=curve)  # CPython3
# ---------- create_vectors.python (70 lines) ----------
import clr
clr.AddReference('ProtoGeometry')
from Autodesk.DesignScript.Geometry import *

# --- Inputs ---
face_pts_x_all = IN[0]  # List of [–X, +X] points per column
face_pts_y_all = IN[1]  # List of [–Y, +Y] points per column
grid_lines = IN[2]      # All Revit grid curves

# --- STEP 1: Classify Grids into Horizontal and Vertical ---
horizontal_grids = []
vertical_grids = []

for g in grid_lines:
    if not isinstance(g, Line):
        continue
    sp = g.StartPoint
    ep = g.EndPoint
    dx = abs(ep.X - sp.X)
    dy = abs(ep.Y - sp.Y)
    if dx > dy:
        horizontal_grids.append(g)  # left-right (for Y face)
    else:
        vertical_grids.append(g)    # up-down (for X face)

# --- STEP 2: Flatten to XY plane ---
def flatten_point(pt):
    return Point.ByCoordinates(pt.X, pt.Y, 0)

def shortest_vector_to_grids(pt, grids):
    if pt is None: return None, float('inf')
    pt2d = flatten_point(pt)
    min_dist = float('inf')
    best_vector = None
    for grid in grids:
        proj = flatten_point(grid.ClosestPointTo(pt))
        dist = pt2d.DistanceTo(proj)
        if dist < min_dist:
            min_dist = dist
            best_vector = Line.ByStartPointEndPoint(pt, proj)
    return best_vector, min_dist

# --- STEP 3: Loop through all columns (manual longest logic) ---
vectors_x = []
vectors_y = []

count = max(len(face_pts_x_all), len(face_pts_y_all))

for i in range(count):
    # Safely get current face point pairs
    fx = face_pts_x_all[i] if i < len(face_pts_x_all) else [None, None]
    fy = face_pts_y_all[i] if i < len(face_pts_y_all) else [None, None]

    # Check for valid face points
    if fx is None or len(fx) < 2:
        vectors_x.append(None)
    else:
        vec1, dist1 = shortest_vector_to_grids(fx[0], vertical_grids)  # –X
        vec2, dist2 = shortest_vector_to_grids(fx[1], vertical_grids)  # +X
        vectors_x.append(vec1 if dist1 < dist2 else vec2)

    if fy is None or len(fy) < 2:
        vectors_y.append(None)
    else:
        vec1, dist1 = shortest_vector_to_grids(fy[0], horizontal_grids)  # –Y
        vec2, dist2 = shortest_vector_to_grids(fy[1], horizontal_grids)  # +Y
        vectors_y.append(vec1 if dist1 < dist2 else vec2)

# --- Final Output ---
OUT = vectors_x, vectors_y
# ----------------------------------------
flatten = List.Flatten(list=create_vectors@L1)
getting_the_points = Python(IN[0]=flatten, IN[1]=all_elements_of_category, IN[2]=all_elements_of_category_2)  # CPython3
# ---------- getting_the_points.python (29 lines) ----------
import clr
clr.AddReference('ProtoGeometry')
from Autodesk.DesignScript.Geometry import *

def flatten_list(input_list):
    result = []
    for item in input_list:
        if isinstance(item, list):
            result.extend(flatten_list(item))
        else:
            result.append(item)
    return result

# Flatten IN[0] fully to get all Line objects
flat_input = flatten_list(IN[0])

start_end_pairs = []

for line in flat_input:
    try:
        # This will work only on Dynamo Lines, not RevitAPI lines
        if hasattr(line, "StartPoint") and hasattr(line, "EndPoint"):
            start_end_pairs.append([line.StartPoint, line.EndPoint])
        else:
            start_end_pairs.append(None)
    except:
        start_end_pairs.append(None)

OUT = start_end_pairs
# ----------------------------------------
transpose_3 = List.Transpose(lists=getting_the_points)
code_block = CodeBlock { 0; 1; }
X_2 = List.GetItemAtIndex(list=transpose_3, index=code_block.out0)
Y_2 = List.GetItemAtIndex(list=transpose_3, index=code_block.out1)

# group: Get current View
current = Document.Current()
activeView = Document.ActiveView(document=current)

code_block_2 = CodeBlock { 0; 1; }
x_vector = List.GetItemAtIndex(list=create_vectors, index=code_block_2.out0)
element_surfaces_references = Custom[Element Surfaces References](element=all_elements_of_category)  # package Genius Loci; Retrieve the top, bottom, side surfaces and their associated references of the system family. This doesn't work with cylindrical system families (pipe...)
flatten_2 = List.Flatten(list=element_surfaces_references.out5)
flatten_3 = List.Flatten(list=element_surfaces_references.out7)
x_direction_column_references = Python(IN[0]=flatten_2, IN[1]=flatten_3, IN[2]=x_vector)  # CPython3
# ---------- x_direction_column_references.python (24 lines) ----------
# IN[0] : xMinusRefs  list[Reference]   (–X face)
# IN[1] : xPlusRefs   list[Reference]   (+X face)
# IN[2] : vectors_x   list[DS Line]

import clr
clr.AddReference('ProtoGeometry')
from Autodesk.DesignScript.Geometry import Line

minus, plus, vecs = IN
chosen = []

for m, p, v in zip(minus, plus, vecs):
    if v is None:               # skip if no vector
        chosen.append(None)
        continue
    # compare which face the vector starts from:
    #  • if its StartPoint equals (or is very close to) the –X face point, pick m
    #  • otherwise pick p
    if abs(v.StartPoint.X - v.EndPoint.X) < 1e-6:   # vertical vector ⇒ must be ±X faces
        chosen.append(m if v.StartPoint.X < v.EndPoint.X else p)
    else:
        # safer: use whichever reference lives on the smaller distance
        chosen.append(m)        # fallback: assume you know order
OUT = chosen
# ----------------------------------------
python_script = Python(IN[0]=all_elements_of_category_2)  # CPython3
# ---------- python_script.python (44 lines) ----------
# -*- coding: utf-8 -*-
"""
Split a list of Grid elements into horizontal (X-direction)
and vertical (Y-direction) groups.

IN[0] : grids_in  list[Grid elements]  (Dynamo wrappers)

OUT[0] : horizontal_grids  list[Grid elements]
OUT[1] : vertical_grids    list[Grid elements]
"""

import clr
clr.AddReference('RevitAPI')
clr.AddReference('RevitServices')
clr.AddReference('RevitNodes')

from Autodesk.Revit.DB import Grid
from RevitServices.Persistence import DocumentManager
import Revit
clr.ImportExtensions(Revit.Elements)          # UnwrapElement()

# ---------- INPUT ----------
grids_in = IN[0]  # expect flat list of Dynamo Grid elements

# ---------- PROCESS ----------
horizontal_grids = []
vertical_grids   = []

for g_dy in grids_in:
    db_grid = UnwrapElement(g_dy)
    if not isinstance(db_grid, Grid):
        continue                        # skip any stray geometry/nulls

    curve = db_grid.Curve               # DB.Line or DB.Arc
    sp, ep = curve.GetEndPoint(0), curve.GetEndPoint(1)
    dx, dy = abs(ep.X - sp.X), abs(ep.Y - sp.Y)

    if dx > dy:                         # more horizontal
        horizontal_grids.append(db_grid)
    else:                               # more vertical (or equal)
        vertical_grids.append(db_grid)

# ---------- OUTPUT ----------
OUT = horizontal_grids, vertical_grids
# ----------------------------------------
code_block_3 = CodeBlock { 0; 1; }
vertical_grid = List.GetItemAtIndex(list=python_script, index=code_block_3.out1)
number_2 = DoubleInput(3)  # graph input

# group: Get dimesnion Type
element_classes = ElementTypes("DimensionType")
all_elements_of_class = ElementsOfType(element_class=element_classes)
code_block_4 = CodeBlock { 0; }
getItemAtIndex = List.GetItemAtIndex(list=all_elements_of_class, index=code_block_4)
name = Element.Name(element=all_elements_of_class)

y_vector = List.GetItemAtIndex(list=create_vectors, index=code_block_2.out1)
flatten_4 = List.Flatten(list=element_surfaces_references.out9)
flatten_5 = List.Flatten(list=element_surfaces_references.out11)
y_direction_column_references = Python(IN[0]=flatten_4, IN[1]=flatten_5, IN[2]=y_vector)  # CPython3; same code as x_direction_column_references
horizontal_grid = List.GetItemAtIndex(list=python_script, index=code_block_3.out0)

# group: dimensions
python_script_2 = Python(IN[0]=activeView, IN[1]=x_vector, IN[2]=x_direction_column_references, IN[3]=vertical_grid, IN[4]=number_2, IN[5]=getItemAtIndex)  # CPython3
# ---------- python_script_2.python (138 lines) ----------
# -*- coding: utf-8 -*-
"""
Draw ticks on the column face and dimension them to the nearest perpendicular
straight grid. Tick length = half column thickness.
Dimension offset = multiplier × half column thickness.

IN[0] : view_dy   Dynamo-wrapped plan View
IN[1] : vectors   list[DS Line | None]
IN[2] : col_refs  list[Reference | None]
IN[3] : grids_in  list[Grid]
IN[4] : offset_multiplier float  (1 = half column, 2 = full column, etc.)
IN[5] : dimType   DimensionType | None

OUT[0] : ticks  list[DetailLine]
OUT[1] : dims   list[Dimension | None]
"""
# ───────── imports ─────────
import clr
clr.AddReference("RevitAPI")
clr.AddReference("RevitServices")
clr.AddReference("RevitNodes")
clr.AddReference("ProtoGeometry")

from Autodesk.Revit.DB import *
from RevitServices.Persistence import DocumentManager
from RevitServices.Transactions import TransactionManager
import Revit
clr.ImportExtensions(Revit.Elements)
clr.ImportExtensions(Revit.GeometryConversion)

# ───────── inputs ─────────
view_dy, vectors, col_refs, grids_in, offset_mult_in, dimType_in = IN + [None]*(6-len(IN))

view    = UnwrapElement(view_dy)
doc     = DocumentManager.Instance.CurrentDBDocument
dimType = UnwrapElement(dimType_in) if dimType_in else None
offset_mult = float(offset_mult_in) if offset_mult_in else 1.0

# ───────── helper functions ─────────
def unit_xy(xyz):
    return XYZ(xyz.X, xyz.Y, 0).Normalize()

def perp_dir(vec):
    return XYZ(0, 1, 0) if abs(vec.X) > abs(vec.Y) else XYZ(1, 0, 0)

def offset(pt, vec, d):
    return XYZ(pt.X + vec.X*d, pt.Y + vec.Y*d, pt.Z + vec.Z*d)

def half_thickness(col_elem, n_vec):
    bb = col_elem.get_BoundingBox(None)
    dx = abs(bb.Max.X - bb.Min.X)
    dy = abs(bb.Max.Y - bb.Min.Y)
    return (dx * 0.5) if abs(n_vec.X) > abs(n_vec.Y) else (dy * 0.5)

# ───────── collect straight grids ─────────
grids = []
for g in grids_in:
    g_el = UnwrapElement(g)
    if not isinstance(g_el, Grid):          continue
    if not isinstance(g_el.Curve, Line):    continue
    try:
        g_ref = g_el.GetReference()
    except AttributeError:
        g_ref = Reference(g_el)
    grids.append((g_el.Curve, g_ref))

if not grids:
    raise Exception("IN[3] contains no straight grids")

# ───────── main transaction ─────────
ticks_out, dims_out = [], []
TransactionManager.Instance.EnsureInTransaction(doc)

for cref, v in zip(col_refs, vectors):

    if None in (cref, v):
        ticks_out.extend([None, None])
        dims_out.append(None)
        continue

    line_revit = v.ToRevitType()
    p0, p1     = line_revit.GetEndPoint(0), line_revit.GetEndPoint(1)
    n_vec      = perp_dir(line_revit.Direction)

    col_elem   = doc.GetElement(cref.ElementId)
    half_size  = half_thickness(col_elem, n_vec)

    # Tick stays at half column size
    tick_len   = half_size
    half_tick  = tick_len / 2.0

    # Create ticks on face
    t0 = Line.CreateBound(offset(p0, n_vec, -half_tick),
                          offset(p0, n_vec,  half_tick))
    t1 = Line.CreateBound(offset(p1, n_vec, -half_tick),
                          offset(p1, n_vec,  half_tick))
    dl0 = doc.Create.NewDetailCurve(view, t0)
    dl1 = doc.Create.NewDetailCurve(view, t1)
    ticks_out.extend([dl0, dl1])

    # Find nearest perpendicular grid
    v_dir      = unit_xy(line_revit.Direction)
    best_ref   = None
    best_dist  = 1e99

    for g_curve, g_ref in grids:
        g_dir = unit_xy(g_curve.Direction)
        if abs(g_dir.DotProduct(v_dir)) > 0.3:
            continue
        d = g_curve.Project(p1).Distance
        if d < best_dist:
            best_dist, best_ref = d, g_ref

    if best_ref is None:
        dims_out.append(None)
        continue

    # Dimension baseline offset = multiplier × half column size
    dim_offset = offset_mult * half_size
    dim_line = Line.CreateBound(offset(p0, n_vec, dim_offset),
                                offset(p1, n_vec, dim_offset))

    ra = ReferenceArray()
    ra.Append(best_ref)
    ra.Append(dl0.GeometryCurve.Reference)

    if doc.IsFamilyDocument:
        dim = doc.FamilyCreate.NewDimension(view, dim_line, ra, dimType) if dimType \
              else doc.FamilyCreate.NewDimension(view, dim_line, ra)
    else:
        dim = doc.Create.NewDimension(view, dim_line, ra, dimType) if dimType \
              else doc.Create.NewDimension(view, dim_line, ra)

    dims_out.append(dim)

TransactionManager.Instance.TransactionTaskDone()

OUT = ticks_out, dims_out
# ----------------------------------------
python_script_3 = Python(IN[0]=activeView, IN[1]=y_vector, IN[2]=y_direction_column_references, IN[3]=horizontal_grid, IN[4]=number_2, IN[5]=getItemAtIndex)  # CPython3; same code as python_script_2
