# Dynamo graph Join floors, slab edges, foundation and switches join order_2023-2024.dyn "Join floors and foundation and switches join order" (Dynamo 2.16.4.10216)

# group: Change join order of SOG and Sub Structure
select_model_elements_by = DSModelElementsByCategorySelection("OST_Floors")  # "Select Model Elements By Category"; nothing selected; graph input
select_model_elements_by_2 = DSModelElementsByCategorySelection("OST_EdgeSlab")  # "Select Model Elements By Category"; 1 picked in the model; graph input
python_script = Python(IN[0]=select_model_elements_by, IN[1]=select_model_elements_by_2)  # CPython3
# ---------- python_script.python (85 lines) ----------
import clr
clr.AddReference("RevitServices")
clr.AddReference("RevitAPI")
from RevitServices.Persistence import DocumentManager
from RevitServices.Transactions import TransactionManager
from Autodesk.Revit.DB import *

# Document
doc = DocumentManager.Instance.CurrentDBDocument

# Inputs
floors_input = IN[0]
slab_edges_input = IN[1]

floors = UnwrapElement(floors_input) if isinstance(floors_input, list) else [UnwrapElement(floors_input)]
slab_edges = UnwrapElement(slab_edges_input) if isinstance(slab_edges_input, list) else [UnwrapElement(slab_edges_input)]

# Collect all structural foundations in the project
foundations = FilteredElementCollector(doc)\
    .OfCategory(BuiltInCategory.OST_StructuralFoundation)\
    .WhereElementIsNotElementType().ToElements()

# --- Bounding box intersection check ---
def bounding_boxes_intersect(elem1, elem2):
    try:
        bb1 = elem1.get_BoundingBox(doc.ActiveView)
        bb2 = elem2.get_BoundingBox(doc.ActiveView)
        if bb1 is None or bb2 is None:
            return False
        outline1 = Outline(bb1.Min, bb1.Max)
        outline2 = Outline(bb2.Min, bb2.Max)
        return outline1.Intersects(outline2, 0.01)  # 0.01 = tolerance
    except:
        return False

TransactionManager.Instance.EnsureInTransaction(doc)
log = []

# 1. Floor ↔ Foundation
for floor in floors:
    for fnd in foundations:
        if bounding_boxes_intersect(floor, fnd):
            try:
                if not JoinGeometryUtils.AreElementsJoined(doc, floor, fnd):
                    JoinGeometryUtils.JoinGeometry(doc, floor, fnd)
                if not JoinGeometryUtils.IsCuttingElementInJoin(doc, floor, fnd):
                    JoinGeometryUtils.SwitchJoinOrder(doc, floor, fnd)
                log.append(f"✅ Floor {floor.Id} cuts Foundation {fnd.Id}")
            except:
                log.append(f"❌ Failed: Floor {floor.Id} ↔ Foundation {fnd.Id}")
        else:
            log.append(f"⛔ Skipped (no intersection): Floor {floor.Id} ↔ Foundation {fnd.Id}")

# 2. Floor ↔ SlabEdge
for floor in floors:
    for edge in slab_edges:
        if bounding_boxes_intersect(floor, edge):
            try:
                if not JoinGeometryUtils.AreElementsJoined(doc, floor, edge):
                    JoinGeometryUtils.JoinGeometry(doc, floor, edge)
                if not JoinGeometryUtils.IsCuttingElementInJoin(doc, floor, edge):
                    JoinGeometryUtils.SwitchJoinOrder(doc, floor, edge)
                log.append(f"✅ Floor {floor.Id} cuts SlabEdge {edge.Id}")
            except:
                log.append(f"❌ Failed: Floor {floor.Id} ↔ SlabEdge {edge.Id}")
        else:
            log.append(f"⛔ Skipped (no intersection): Floor {floor.Id} ↔ SlabEdge {edge.Id}")

# 3. Foundation ↔ SlabEdge
for fnd in foundations:
    for edge in slab_edges:
        if bounding_boxes_intersect(fnd, edge):
            try:
                if not JoinGeometryUtils.AreElementsJoined(doc, fnd, edge):
                    JoinGeometryUtils.JoinGeometry(doc, fnd, edge)
                if not JoinGeometryUtils.IsCuttingElementInJoin(doc, fnd, edge):
                    JoinGeometryUtils.SwitchJoinOrder(doc, fnd, edge)
                log.append(f"✅ Foundation {fnd.Id} cuts SlabEdge {edge.Id}")
            except:
                log.append(f"❌ Failed: Foundation {fnd.Id} ↔ SlabEdge {edge.Id}")
        else:
            log.append(f"⛔ Skipped (no intersection): Foundation {fnd.Id} ↔ SlabEdge {edge.Id}")

TransactionManager.Instance.TransactionTaskDone()
OUT = log
# ----------------------------------------
